# Grasshopper definition waffle.gh (Grasshopper 0.9.76)

pt = Point(<point referenced from the Rhino model>)
geo = Geometry(<brep referenced from the Rhino model>)
xz = XZPlane(Origin=pt)
bbox = BoundingBox(Content=geo, Plane=PlaneXY(0, 0, 0))  # -> Box, Box_2
debox = DeconstructBox(Box=bbox.Box)  # -> Plane, X, Y, Z
range = Range(Domain=debox.X, Steps=Slider(20, range=0..500))
range_2 = Range(Domain=debox.Y, Steps=Slider(20, range=0..500))
remove_ends = RemoveEnds(L=range)
remove_ends_2 = RemoveEnds(L=range_2)
pt_2 = ConstructPoint(XCoordinate=remove_ends, YCoordinate=0, ZCoordinate=0)
pt_3 = ConstructPoint(XCoordinate=0, YCoordinate=remove_ends_2, ZCoordinate=0)
yz = YZPlane(Origin=pt_2)
xz_2 = XZPlane(Origin=pt_3)
sec = BrepPlane(Brep=geo, Plane=yz)  # -> simplify(Curves), Points
sec_2 = BrepPlane(Brep=geo, Plane=xz_2)  # -> Curves, Points
lng = ListLength(List=sec.Curves)
pt_4 = ConstructPoint(XCoordinate=0, YCoordinate=0, ZCoordinate=0)
panel = Panel(sec.Curves)
orient = Orient(Source=PlaneXY(0, 0, 0), Target=PlaneXY(0, 0, 0))  # -> Geometry, Transform

# ==== cluster RemoveEnds: Removes first and last item of a list
L = ClusterInput()
cull_i = CullIndex(List=reverse(L), Indices=0, Wrap=True)
cull_i_2 = CullIndex(List=reverse(cull_i), Indices=0, Wrap=True)
L_2 = ClusterOutput(cull_i_2)
